# Grasshopper definition Procedural Generation of Tactile Pavement.gh (Grasshopper 1.0.8)
# plug-ins: RhinoCodePluginGH, Pufferfish

# ---- group: Input
geometry_pipeline = GeometryPipeline(
    GroupByLayer=False,
    GroupByType=False,
    IncludeHidden=True,
    IncludeLocked=True,
    LayerFilter="Points",
    NameFilter="*",
    SublayerFiltering=True,
    TypeFilter=1)
geometry_pipeline_2 = GeometryPipeline(
    GroupByLayer=False,
    GroupByType=False,
    IncludeHidden=True,
    IncludeLocked=True,
    LayerFilter="buildings",
    NameFilter="*",
    SublayerFiltering=True,
    TypeFilter=1073741848)
geometry_pipeline_3 = GeometryPipeline(
    GroupByLayer=False,
    GroupByType=False,
    IncludeHidden=True,
    IncludeLocked=True,
    LayerFilter="sidewalk",
    NameFilter="*",
    SublayerFiltering=True,
    TypeFilter=4)
blister_pavement_cost = Panel("7.7")
directional_pavement_cost = Panel("8.6")
expanded_caution_pavements = ValueList({"No": 0, "Yes": 1}, selected="Yes")
curve = Curve(geometry_pipeline_3)

# ---- group: Input / Pavement Size
panel = Panel("1")

# ---- group: Input / Boundary
curve_2 = Curve(<curve referenced from the Rhino model>)

# ---- group: Input / Points of Connection
point = Point(geometry_pipeline)

# ---- group: Input / Obstacles
brep = Brep(geometry_pipeline_2)

# ----
construct_point = ConstructPoint(XCoordinate=0, YCoordinate=0, ZCoordinate=0)
number = Number(panel)
unit_x = UnitX(Factor=number)
unit_y = UnitY(Factor=number)
move = Move(Geometry=construct_point, Motion=unit_x)  # -> Geometry, Transform
plane_normal = PlaneNormal(Origin=construct_point, ZAxis=Vector(0, 0, 1))
move_2 = Move(Geometry=move.Geometry, Motion=unit_y)  # -> Geometry, Transform
rectangle_2pt = Rectangle2Pt(Plane=plane_normal, PointA=move_2.Geometry, PointB=construct_point, Radius=0)  # -> Rectangle, Length
explode = Explode(Curve=rectangle_2pt.Rectangle, Recursive=True)  # -> Segments, Vertices
explode_2 = Explode(Curve=rectangle_2pt.Rectangle, Recursive=True)  # -> Segments, Vertices
polygon_center = PolygonCenter(Polyline=rectangle_2pt.Rectangle)  # -> CenterV, CenterE, CenterA
list_item = ListItem(List=explode.Segments, Index=0, Wrap=True)
list_item_2 = ListItem(List=explode_2.Segments, Index=0, Wrap=True)
number_slider = Slider(7, range=0..10)
divide_curve = DivideCurve(Curve=list_item, Count=Slider(5, range=0..10), Kinks=False)  # -> Points, Tangents, Parameters
end_points = EndPoints(Curve=list_item)  # -> Start, End
divide_curve_2 = DivideCurve(Curve=list_item_2, Count=number_slider, Kinks=False)  # -> Points, Tangents, Parameters
unit_y_2 = UnitY(Factor=1)
closest_point = ClosestPoint(Point=flatten([end_points.Start, end_points.End]), Cloud=divide_curve.Points)  # -> ClosestPoint, CPIndex, Distance
number_2 = Number(number)
line_sdl = LineSDL(Start=divide_curve_2.Points, Direction=unit_y_2, Length=number_2)
cull_index = CullIndex(List=divide_curve.Points, Indices=closest_point.CPIndex, Wrap=True)  # -> flatten(List)
divide_curve_3 = DivideCurve(Curve=explode_2.Segments, Count=number_slider, Kinks=False)  # -> flatten(Points), Tangents, Parameters
divide_curve_4 = DivideCurve(Curve=line_sdl, Count=number_slider, Kinks=False)  # -> flatten(Points), Tangents, Parameters
unit_y_3 = UnitY(Factor=1)
line_sdl_2 = LineSDL(Start=cull_index, Direction=unit_y_3, Length=number_2)
closest_point_2 = ClosestPoint(Point=divide_curve_3.Points, Cloud=divide_curve_4.Points)  # -> ClosestPoint, CPIndex, Distance
number_slider_2 = Slider(1.1, range=0..10)
cull_index_2 = CullIndex(List=divide_curve_4.Points, Indices=closest_point_2.CPIndex, Wrap=True)  # -> flatten(List)
scale_nu = ScaleNU(
    Geometry=line_sdl_2,
    Plane=polygon_center.CenterE,
    ScaleX=Slider(1.1, range=0..10),
    ScaleY=Slider(0.8, range=0..1),
    ScaleZ=1)  # -> Geometry, Transform
scale_nu_2 = ScaleNU(Geometry=cull_index_2, Plane=polygon_center.CenterE, ScaleX=number_slider_2, ScaleY=number_slider_2, ScaleZ=1)  # -> Geometry, Transform
division = Division(A=number, B=Slider(20, range=0..100))
unit_x_2 = UnitX(Factor=division)
move_3 = Move(Geometry=scale_nu.Geometry, Motion=unit_x_2)  # -> Geometry, Transform
multiplication = Multiplication(A=unit_x_2, B="-2")
boundary_surfaces = BoundarySurfaces(Edges=rectangle_2pt.Rectangle)
extrude = Extrude(Base=move_3.Geometry, Direction=multiplication)
deconstruct_brep = DeconstructBrep(Brep=extrude)  # -> Faces, Edges, Vertices
join_curves = JoinCurves(Curves=deconstruct_brep.Edges, Preserve=False)
unit_z = UnitZ(Factor=division)
circle = Circle(Plane=scale_nu_2.Geometry, Radius=division)
fillet = Fillet(Curve=join_curves, Radius=division)
move_4 = Move(Geometry=circle, Motion=unit_z)  # -> Geometry, Transform
move_5 = Move(Geometry=fillet, Motion=unit_z)  # -> Geometry, Transform
boundary_surfaces_2 = BoundarySurfaces(Edges=move_4.Geometry)
boundary_surfaces_3 = BoundarySurfaces(Edges=move_5.Geometry)
division_2 = Division(A=unit_z, B="2")
extrude_2 = Extrude(Base=boundary_surfaces_2, Direction=division_2)
extrude_3 = Extrude(Base=boundary_surfaces, Direction=unit_z)
extrude_4 = Extrude(Base=boundary_surfaces_3, Direction=division_2)
solid_union = SolidUnion(Breps=flatten([extrude_3, extrude_4]))
solid_union_2 = SolidUnion(Breps=flatten([extrude_2, extrude_3]))

explode_3 = Explode(Curve=curve_2, Recursive=True)  # -> Segments, Vertices
number_3 = Number(panel)
construct_point_2 = ConstructPoint(XCoordinate=0, YCoordinate=0, ZCoordinate=Slider(50, range=0..100))
list_item_3 = ListItem(List=explode_3.Segments, Index=0, Wrap=True)  # -> Item, Item1
plane_normal_2 = PlaneNormal(Origin=construct_point_2, ZAxis=Vector(0, 0, 1))
length = Length(Curve=list_item_3.Item1)
length_2 = Length(Curve=list_item_3.Item)
number_4 = Number(panel)
division_3 = Division(A=length_2, B=number_4)
division_4 = Division(A=length, B=number_4)
square = Square(Plane=plane_normal_2, Size=number_4, ExtentX=division_3, ExtentY=division_4)  # -> Cells, Points
split_list = SplitList(List=point, Index="1")  # -> ListA, ListB
self_optimize = ValueList({"Yes": 1, "No": 2}, selected="No")
circle_2 = Circle(Plane=point, Radius=Slider(2, range=0..10))

# ---- group: 起点
point_2 = Point(flatten(split_list.ListA))

# ---- group: 终点
point_3 = Point(flatten(split_list.ListB))

# ----
relay = Relay()
construct_point_3 = ConstructPoint(XCoordinate="-1", YCoordinate="-1", ZCoordinate="250")
line_sdl_3 = LineSDL(Start=construct_point_3, Direction=Vector(0, 0, 1), Length="-500")
number_slider_3 = Slider(1.1, range=0..10)
point_4 = Point(point)
curve_3 = Curve(curve)
boundary_surfaces_4 = BoundarySurfaces(Edges=curve_3)

# ---- group: Direction Pavement
brep_2 = Brep(solid_union)

# ----
point_5 = Point(polygon_center.CenterE)

# ---- group: Caution Pavement
brep_3 = Brep(solid_union_2)

# ----
explode_4 = Explode(Curve=curve_2, Recursive=True)  # -> Segments, Vertices
list_item_4 = ListItem(List=explode_4.Vertices, Index=Slider(0, range=0..100), Wrap=True)
point_6 = Point(list_item_4)
panel_2 = Panel(point_6)
merge = Merge(Data1=curve_2, Data2=point_2, Data3=point_3, Data4=point_3)
ghpython_script = GhPythonScript(x=panel_2)  # -> simplify(flatten(out)), x1, y, z; inputs x: list
# ---------- ghpython_script: Python ----------
__author__ = "Antonio"
__version__ = "2023.04.23"

import rhinoscriptsyntax as rs
for j in range(int(len(x))):
    x[j] = x[j].replace("{","")
    x[j] = x[j].replace("}","")
    x[j] = x[j].replace("'","")
    x[j] = x[j].replace(" ","")
    x[j] = x[j].replace("[","")
    x[j] = x[j].replace("]","")
    x[j] = x[j].split(",")
    for i in range(len(x[j])):
        x[j][i] = float(x[j][i])
for i in range(len(x)):
    x1 = str(0-x[i][0])
    y = str(0-x[i][1])
    z = str(0-x[i][2])
    print("{"+str(x[i][0])+","+str(x[i][1])+","+str(x[i][2])+"}")
# ---------- end ghpython_script ----------
unit_x_3 = UnitX(Factor=ghpython_script.x1)
unit_z_2 = UnitZ(Factor=ghpython_script.z)
unit_y_4 = UnitY(Factor=ghpython_script.y)
move_6 = Move(Geometry=merge, Motion=unit_x_3)  # -> Geometry, Transform
move_7 = Move(Geometry=curve_2, Motion=unit_x_3)  # -> Geometry, Transform
number_slider_4 = Slider(0, range=0..100)
move_8 = Move(Geometry=move_6.Geometry, Motion=unit_y_4)  # -> Geometry, Transform
move_9 = Move(Geometry=move_7.Geometry, Motion=unit_y_4)  # -> Geometry, Transform
move_10 = Move(Geometry=move_8.Geometry, Motion=unit_z_2)  # -> Geometry, Transform
move_11 = Move(Geometry=move_9.Geometry, Motion=unit_z_2)  # -> Geometry, Transform
construct_point_4 = ConstructPoint(XCoordinate=Slider(100, range=0..100), YCoordinate=number_slider_4, ZCoordinate=number_slider_4)
explode_5 = Explode(Curve=move_11.Geometry, Recursive=True)  # -> Segments, Vertices
list_item_5 = ListItem(List=explode_5.Segments, Index=Slider(0, range=0..100), Wrap=True)
multiplication_2 = Multiplication(A=ghpython_script.x1, B="-1")
multiplication_3 = Multiplication(A="-1", B=ghpython_script.z)
multiplication_4 = Multiplication(A=ghpython_script.y, B="-1")
point_7 = Point(construct_point_4)
number_slider_5 = Slider(0, range=0..100)
line = Line(list_item_5)
unit_x_4 = UnitX(Factor=multiplication_2)
unit_y_5 = UnitY(Factor=multiplication_4)
unit_z_3 = UnitZ(Factor=multiplication_3)
end_points_2 = EndPoints(Curve=line)  # -> Start, End
construct_point_5 = ConstructPoint(XCoordinate=number_slider_5, YCoordinate=number_slider_5, ZCoordinate=number_slider_5)
point_8 = Point(end_points_2.End)
vector_2pt = Vector2Pt(PointA=construct_point_5, PointB=point_7, Unitize=False)  # -> Vector, Length
vector_2pt_2 = Vector2Pt(PointA=construct_point_5, PointB=point_8, Unitize=False)  # -> Vector, Length
angle = Angle(VectorA=vector_2pt_2.Vector, VectorB=vector_2pt.Vector)  # -> Angle, Reflex

move_12 = Move(Geometry=brep, Motion=unit_x_3)  # -> Geometry, Transform
move_13 = Move(Geometry=move_12.Geometry, Motion=unit_y_4)  # -> Geometry, Transform
move_14 = Move(Geometry=move_13.Geometry, Motion=unit_z_2)  # -> Geometry, Transform
rotate = Rotate(Geometry=move_10.Geometry, Angle=angle.Angle, Plane=PlaneXY(0, 0, 0))  # -> Geometry, Transform
list_item_6 = ListItem(List=rotate.Geometry, Index="0", Wrap=True)
boundary_surfaces_5 = BoundarySurfaces(Edges=list_item_6)
surface_line = SurfaceLine(Surface=boundary_surfaces_5, Line=line_sdl_3, LimitToFirst=False)  # -> Curves, flatten(Points), UVPoints, Normal
ghpython_script_2 = GhPythonScript(x=surface_line.Points)  # -> out, a; inputs x: list
# ---------- ghpython_script_2: Python ----------
__author__ = "Antonio"
__version__ = "2023.07.28"

import rhinoscriptsyntax as rs

if x == []:
    print(1)
else:
    print(-1)
# ---------- end ghpython_script_2 ----------
multiplication_5 = Multiplication(A=angle.Angle, B=ghpython_script_2.out)
rotate_2 = Rotate(Geometry=move_14.Geometry, Angle=multiplication_5, Plane=PlaneXY(0, 0, 0))  # -> Geometry, Transform

multiplication_6 = Multiplication(A=multiplication_5, B="-1")
rotate_3 = Rotate(Geometry=move_10.Geometry, Angle=multiplication_5, Plane=PlaneXY(0, 0, 0))  # -> Geometry, Transform
list_item_7 = ListItem(List=rotate_3.Geometry, Index="0", Wrap=True)
curve_4 = Curve(simplify(flatten(list_item_7)))
brep_4 = Brep(simplify(flatten(rotate_2.Geometry)))

number_5 = Number(multiplication_6)
split_list_2 = SplitList(List=rotate_3.Geometry, Index=Slider(1, range=0..10))  # -> ListA, ListB

# ---- group: Obstacles
brep_5 = Brep(brep_4)

# ---- group: Boundary Curve
curve_5 = Curve(curve_4)

# ----
curve_6 = Curve(curve_5)
boundary_surfaces_6 = BoundarySurfaces(Edges=curve_6)

# ---- group: Points to connect
point_9 = Point(split_list_2.ListB)

# ----
bounding_box = BoundingBox(Content=brep_5, Plane=PlaneXY(0, 0, 0))  # -> Box, Box_2
brep_6 = Brep(bounding_box.Box)
solid_union_3 = SolidUnion(Breps=brep_6)
split_brep = SplitBrep(Brep=solid_union_3, Cutter=boundary_surfaces_6)
split_list_3 = SplitList(List=split_brep, Index=Slider(1, range=0..100))  # -> ListA, ListB
surface = Surface(split_list_3.ListA)
brep_edges = BrepEdges(Brep=surface)  # -> Naked, Interior, NonManifold
join_curves_2 = JoinCurves(Curves=brep_edges.Naked, Preserve=False)
polygon_center_2 = PolygonCenter(Polyline=join_curves_2)  # -> CenterV, CenterE, CenterA

curve_7 = Curve(curve_5)
brep_7 = Brep(bounding_box.Box)
boundary_surfaces_7 = BoundarySurfaces(Edges=curve_7)
solid_union_4 = SolidUnion(Breps=brep_7)
split_brep_2 = SplitBrep(Brep=solid_union_4, Cutter=boundary_surfaces_7)
split_list_4 = SplitList(List=split_brep_2, Index=Slider(1, range=0..100))  # -> ListA, ListB
brep_8 = Brep(split_list_4.ListB)
split_brep_3 = SplitBrep(Brep=flatten(boundary_surfaces_7), Cutter=flatten(brep_8))
split_list_5 = SplitList(List=split_brep_3, Index=Slider(1, range=0..100))  # -> ListA, ListB
brep_9 = Brep(split_list_5.ListB)
brep_edges_2 = BrepEdges(Brep=brep_9)  # -> Naked, Interior, NonManifold
join_curves_3 = JoinCurves(Curves=brep_edges_2.Naked, Preserve=False)
boundary_surfaces_8 = BoundarySurfaces(Edges=flatten([curve_7, join_curves_3]))
split_list_6 = SplitList(List=boundary_surfaces_8, Index=Slider(0, range=0..100))  # -> ListA, ListB
explode_tree = ExplodeTree(Data=boundary_surfaces_8)  # -> Branch0, Branch1, Branch2, Branch3
brep_10 = Brep(flatten(split_list_4.ListB))
brep_11 = Brep(explode_tree.Branch0)
solid_union_5 = SolidUnion(Breps=[brep_11, brep_10])
brep_12 = Brep(solid_union_5)

scale_nu_3 = ScaleNU(
    Geometry=bounding_box.Box,
    Plane=flatten(polygon_center_2.CenterV),
    ScaleX=graft(number_slider_3),
    ScaleY=graft(number_slider_3),
    ScaleZ=1)  # -> Geometry, Transform
brep_13 = Brep(scale_nu_3.Geometry)

# ---- group: Environment
brep_14 = Brep(brep_12)

# ----
construct_point_6 = ConstructPoint(XCoordinate=0, YCoordinate=0, ZCoordinate=0)
unit_z_4 = UnitZ(Factor="100")
move_15 = Move(Geometry=construct_point_6, Motion=unit_z_4)  # -> Geometry, Transform
unit_z_5 = UnitZ(Factor=1)
project = Project(Curve=square.Cells, Brep=brep_14, Direction=unit_z_5)
extremes = Extremes(Curve=project, Plane=PlaneXY(0, 0, 0))  # -> Highest, Lowest
plane_normal_3 = PlaneNormal(Origin=extremes.Highest, ZAxis=Vector(0, 0, 1))
project_2 = Project(Geometry=project, Plane=plane_normal_3)  # -> Geometry, Transform
control_polygon = ControlPolygon(Curve=project_2.Geometry)  # -> Polygon, Points
polyline = PolyLine(Vertices=control_polygon.Points, Closed=False)  # -> simplify(Polyline)
path_mapper = PathMapper(polyline, source="{a;b}", target="{a;b/1000}")
curve_8 = Curve(path_mapper)
polygon_center_3 = PolygonCenter(Polyline=curve_8)  # -> CenterV, simplify(CenterE), CenterA
point_10 = Point(polygon_center_3.CenterE)
panel_3 = Panel(point_10)

closest_points = ClosestPoints(Point=flatten(point_4), Cloud=flatten(point_10), Count=3)  # -> ClosestPoint, CPIndex, Distance
point_11 = Point(closest_points.ClosestPoint)
list_item_8 = ListItem(List=point_11, Index=0, Wrap=True)  # -> flatten(Item)
panel_4 = Panel(list_item_8)
python_3_script = Python3Script(x=panel_3)  # -> flatten(out), a; inputs x: list
# ---------- python_3_script: Python ----------
"""Grasshopper Script"""
a = "Hello Python 3 in Grasshopper!"
print(x)
# ---------- end python_3_script ----------
list_item_9 = ListItem(List=list_item_8, Index=Slider(17, range=0..100), Wrap=True)  # -> flatten(Item)
panel_5 = Panel(python_3_script.out)
panel_6 = Panel(list_item_9)
python_3_script_2 = Python3Script(x=panel_4, y=Slider(5, range=0..10))  # -> out, start_points, end_points; inputs x: list
# ---------- python_3_script_2: Python ----------
def parse_coordinates(coord_strings):
    """Parse the input coordinate strings into a list of (x, y, z) tuples."""
    coords = []
    for s in coord_strings:
        # Remove braces and split the string by commas
        s = s.strip('{}')
        x, y, z = map(float, s.split(','))
        coords.append((x, y, z))
    return coords

def find_closest_in_direction(points, index, direction, tolerance=5):
    """Find the closest point in the specified direction ('N', 'S', 'E', 'W') within tolerance."""
    x1, y1, _ = points[index]
    closest_point = None
    min_distance = float('inf')
    
    for i, (x2, y2, _) in enumerate(points):
        if i == index:
            continue
        
        # Check for directions with tolerance
        if direction == 'N' and abs(x1 - x2) <= tolerance and y2 > y1:  # North: Close x, larger y
            distance = y2 - y1
        elif direction == 'S' and abs(x1 - x2) <= tolerance and y2 < y1:  # South: Close x, smaller y
            distance = y1 - y2
        elif direction == 'E' and abs(y1 - y2) <= tolerance and x2 > x1:  # East: Close y, larger x
            distance = x2 - x1
        elif direction == 'W' and abs(y1 - y2) <= tolerance and x2 < x1:  # West: Close y, smaller x
            distance = x1 - x2
        else:
            continue  # Not a valid point in the given direction
        
        if distance < min_distance:
            min_distance = distance
            closest_point = i
    
    return closest_point

def connect_closest_points(coord_strings, tolerance=y):
    """Connect each point to the closest point in all four cardinal directions with tolerance."""
    coords = parse_coordinates(coord_strings)
    start_points = []
    end_points = []
    
    directions = ['N', 'S', 'E', 'W']
    
    for i in range(len(coords)):
        for direction in directions:
            closest_point = find_closest_in_direction(coords, i, direction, tolerance)
            if closest_point is not None:
                start_points.append(i)
                end_points.append(closest_point)
    
    return start_points, end_points

# Example usage
coord_strings = x

# Set tolerance to 5
start_points, end_points = connect_closest_points(coord_strings, tolerance=5)
print("Start Points:", start_points)
print("End Points:", end_points)
# ---------- end python_3_script_2 ----------
python_3_script_3 = Python3Script(x=panel_5)  # -> out, a; inputs x: list; same code as python_3_script
list_item_10 = ListItem(List=list_item_8, Index=python_3_script_2.start_points, Wrap=True)  # -> flatten(Item)
list_item_11 = ListItem(List=list_item_8, Index=python_3_script_2.end_points, Wrap=True)  # -> flatten(Item)
closest_points_2 = ClosestPoints(Point=list_item_10, Cloud=flatten(point_10), Count=3)  # -> ClosestPoint, CPIndex, Distance
closest_points_3 = ClosestPoints(Point=list_item_11, Cloud=flatten(point_10), Count=3)  # -> ClosestPoint, CPIndex, Distance
list_item_12 = ListItem(List=closest_points_2.ClosestPoint, Index=0, Wrap=True)  # -> flatten(Item)
list_item_13 = ListItem(List=closest_points_3.ClosestPoint, Index=0, Wrap=True)  # -> flatten(Item)
line_2 = Line(StartPoint=list_item_12, EndPoint=list_item_13)
curve_middle = CurveMiddle(Curve=line_2)
list_item_14 = ListItem(List=closest_points_3.CPIndex, Index=0, Wrap=True)  # -> flatten(Item)
panel_7 = Panel(curve_middle)
list_item_15 = ListItem(List=closest_points_2.CPIndex, Index=0, Wrap=True)  # -> flatten(Item)
python_3_script_4 = Python3Script(x=panel_7)  # -> out, result; inputs x: list
# ---------- python_3_script_4: Python ----------
def remove_duplicates_and_get_indexes(coordinate_list):
    # Create a set to store unique coordinates
    unique_coordinates = []
    indexes = []
    
    for index, coord in enumerate(coordinate_list):
        if coord not in unique_coordinates:
            unique_coordinates.append(coord)
            indexes.append(index)

    return indexes

# Example usage:
coordinate_list = x

result = remove_duplicates_and_get_indexes(coordinate_list)
# ---------- end python_3_script_4 ----------
list_item_16 = ListItem(List=list_item_14, Index=python_3_script_4.result, Wrap=True)  # -> flatten(Item)
list_item_17 = ListItem(List=list_item_15, Index=python_3_script_4.result, Wrap=True)  # -> flatten(Item)
panel_8 = Panel(python_3_script_4.result)
list_item_18 = ListItem(List=line_2, Index=panel_8, Wrap=True)  # -> flatten(Item)

# ---- group: Center Algo
python_3_script_5 = Python3Script(environment=python_3_script_3.out, start=list_item_17, end=list_item_16)  # -> out, a, paths; inputs environment: list, start: list, end: list
# ---------- python_3_script_5: Python ----------
def importenvironment(environment):
    # Step 1: Clean the outermost list
    environment = environment[0].strip('[]')
    
    # Step 2: Split the environment into individual rows
    rows = environment.split('", "')  # This splits the environment into rows

    matrix = []

    for row in rows:
        # Step 3: Clean the row and split into individual coordinates
        row = row.strip('[]"')  # Remove any leftover brackets and quotes
        coordinates = row.split(", '")  # Split into individual coordinate strings

        matrix_row = []
        for coord in coordinates:
            # Step 4: Strip braces and spaces, then split by commas to get x, y, z
            coord = coord.strip("{} '")  # Clean braces and spaces
            x_value, y_value, z_value = map(float, coord.split(','))  # Convert x, y, z to floats

            # Step 5: Check z_value to mark as obstacle (1) or free space (0)
            if z_value != 0:
                matrix_row.append(1)  # Mark as obstacle if z-axis is non-zero
            else:
                matrix_row.append(0)  # Free space if z is zero
        
        matrix.append(matrix_row)  # Add the processed row to the matrix

    return matrix

# Example input as a single list
envi = environment
# Generate matrix
matrixinitial = importenvironment(envi)

# Print matrix for debugging
#______________________________________________________________A*_______________________________________________________________________________________________________


import heapq

# Converts 1D index to 2D (row, col) index based on the matrix width
def index_to_coordinates(index, width):
    return index // width, index % width

# Converts 2D (row, col) index to 1D index
def coordinates_to_index(row, col, width):
    return row * width + col

# Heuristic function: Manhattan distance
def heuristic(a, b):
    return abs(a[0] - b[0]) + abs(a[1] - b[1])

# A* algorithm implementation
def a_star(matrix, start_idx, end_idx):
    rows, cols = len(matrix), len(matrix[0])
    start = index_to_coordinates(start_idx, cols)
    end = index_to_coordinates(end_idx, cols)

    # Priority queue
    open_list = []
    heapq.heappush(open_list, (0, start))

    came_from = {}
    g_score = {start: 0}
    f_score = {start: heuristic(start, end)}

    while open_list:
        _, current = heapq.heappop(open_list)

        # If we reach the target
        if current == end:
            # Reconstruct path
            path = []
            while current in came_from:
                path.append(coordinates_to_index(current[0], current[1], cols))
                current = came_from[current]
            path.append(coordinates_to_index(start[0], start[1], cols))  # Append start point
            return path[::-1]  # Return reversed path

        # Possible 4-directional movement
        neighbors = [
            (current[0] - 1, current[1]),  # Up
            (current[0] + 1, current[1]),  # Down
            (current[0], current[1] - 1),  # Left
            (current[0], current[1] + 1),  # Right
        ]

        for neighbor in neighbors:
            row, col = neighbor
            if 0 <= row < rows and 0 <= col < cols and matrix[row][col] == 0:  # Ensure valid position and not obstacle
                tentative_g_score = g_score[current] + 1

                if neighbor not in g_score or tentative_g_score < g_score[neighbor]:
                    came_from[neighbor] = current
                    g_score[neighbor] = tentative_g_score
                    f_score[neighbor] = tentative_g_score + heuristic(neighbor, end)
                    heapq.heappush(open_list, (f_score[neighbor], neighbor))

    return []  # Return empty path if no solution found

# Main function to process all start and end points
def find_paths(matrix, start_points, end_points):
    all_paths = []
    for start_idx, end_idx in zip(start_points, end_points):
        path = a_star(matrix, start_idx, end_idx)
        all_paths.append(path)
    return all_paths
def print_individual_numbers(list_of_lists):
    for sublist in list_of_lists:
        for number in sublist:
            print(number)

# Test the function
matrix = matrixinitial
start_points = start
end_points = end

paths = find_paths(matrix, start_points, end_points)
            

print_individual_numbers(paths)
# ---------- end python_3_script_5 ----------

# ----
panel_9 = Panel(python_3_script_5.out)
list_item_19 = ListItem(List=flatten(point_10), Index=panel_9, Wrap=True)
cull_duplicates = CullDuplicates(Points=list_item_19, Tolerance=0.1, CullMode=3)  # -> Points, Indices, Valence
panel_10 = Panel(cull_duplicates.Points)
python_3_script_6 = Python3Script(x=panel_10)  # -> out, a; inputs x: list
# ---------- python_3_script_6: Python ----------
print(x)
# ---------- end python_3_script_6 ----------
point_12 = Point(flatten(cull_duplicates.Points))
flip_matrix = FlipMatrix(Data=point_12)
line_sdl_4 = LineSDL(Start=point_12, Direction=Vector(0, 0, 1), Length="-1")
surface_line_2 = SurfaceLine(Surface=graft(boundary_surfaces_4), Line=flatten(line_sdl_4), LimitToFirst=False)  # -> Curves, Points, UVPoints, Normal
point_13 = Point(flatten(surface_line_2.Points))
panel_11 = Panel(point_13)
python_3_script_7 = Python3Script(x=panel_11)  # -> flatten(out), a; inputs x: list; same code as python_3_script
panel_12 = Panel(python_3_script_7.out)

python_3_script_8 = Python3Script(x=panel_12, y=number_3)  # -> flatten(out), fails, passes, directions, one_neighbor, one_neighbor_directions; inputs x: list
# ---------- python_3_script_8: Python ----------
import ast
import math

# Input list of strings
coord_list_str = x  # Placeholder for your input list  # Set your custom unit distance here
tolerance = 1e-6  # Small tolerance for floating-point comparisons

# Combine all strings into one and parse the coordinate strings
coords = []
for coord_str in coord_list_str:
    # Convert each string into a list of tuples
    coords += [tuple(map(float, coord.strip('{}').split(','))) for coord in ast.literal_eval(coord_str)]

# Function to check if two points differ by approximately y (within tolerance) in one coordinate
def is_adjacent(point1, point2, y):
    diff = [abs(p1 - p2) for p1, p2 in zip(point1, point2)]
    # Return True if one coordinate differs by approximately y and the others are the same
    return sum(math.isclose(d, y, abs_tol=tolerance) for d in diff) == 1 and sum(math.isclose(d, 0, abs_tol=tolerance) for d in diff) == 2

# Function to return axis direction in the format {x, y, z}
def get_axis_direction(point, neighbor, y):
    for k in range(3):
        if math.isclose(abs(point[k] - neighbor[k]), y, abs_tol=tolerance):
            if k == 0:  # X-axis
                return "{1, 0, 0}"
            elif k == 1:  # Y-axis
                return "{0, 1, 0}"
            elif k == 2:  # Z-axis
                return "{0, 0, 1}"
    return "{0, 0, 0}"

# Lists to hold indexes of points that pass, fail, points with exactly one neighbor, and directions
passes = []
fails = []
one_neighbor = []  # To hold points with exactly one neighbor
directions = []
one_neighbor_directions = []  # To hold directions for points with one neighbor

# Iterate over all points and check the condition
for i, point in enumerate(coords):
    neighbors = []
    # Find neighbors that differ by approximately y in one coordinate
    for j, other_point in enumerate(coords):
        if i != j and is_adjacent(point, other_point, y):
            neighbors.append(j)

    # If the point has exactly one neighbor, add it to the one_neighbor list and get the direction
    if len(neighbors) == 1:
        one_neighbor.append(i)
        one_neighbor_directions.append(get_axis_direction(point, coords[neighbors[0]], y))

    # Check if there are exactly two neighbors
    elif len(neighbors) == 2:
        # Ensure both neighbors differ along the same axis and are aligned
        for k in range(3):
            if math.isclose(abs(point[k] - coords[neighbors[0]][k]), y, abs_tol=tolerance) and \
               math.isclose(abs(point[k] - coords[neighbors[1]][k]), y, abs_tol=tolerance):
                # Ensure the other two coordinates are the same
                if (math.isclose(coords[neighbors[0]][(k + 1) % 3], point[(k + 1) % 3], abs_tol=tolerance) and
                    math.isclose(coords[neighbors[0]][(k + 2) % 3], point[(k + 2) % 3], abs_tol=tolerance) and
                    math.isclose(coords[neighbors[1]][(k + 1) % 3], point[(k + 1) % 3], abs_tol=tolerance) and
                    math.isclose(coords[neighbors[1]][(k + 2) % 3], point[(k + 2) % 3], abs_tol=tolerance)):
                    passes.append(i)
                    directions.append(get_axis_direction(point, coords[neighbors[0]], y))  # Or use the 2nd neighbor
                    break
        else:
            fails.append(i)
    else:
        fails.append(i)

# Output the lists of indexes that pass, fail, points with one neighbor, and the directions
print("Passes:", passes)
print("Fails:", fails)
print("One Neighbor:", one_neighbor)
print("One Neighbor Directions:", one_neighbor_directions)
print("Directions:", directions)
# ---------- end python_3_script_8 ----------
python_3_script_9 = Python3Script(x=panel_12)  # -> flatten(out), fails, passes, directions; inputs x: list
# ---------- python_3_script_9: Python ----------
import ast

# Input list of strings
coord_list_str = x
# Combine all strings into one and parse the coordinate strings
coords = []
for coord_str in coord_list_str:
    # Convert each string into a list of tuples
    coords += [tuple(map(float, coord.strip('{}').split(','))) for coord in ast.literal_eval(coord_str)]

# Function to check if two points differ by exactly 1 in one coordinate and are otherwise equal
def is_adjacent(point1, point2):
    diff = [abs(p1 - p2) for p1, p2 in zip(point1, point2)]
    return sum(d == 1 for d in diff) == 1 and sum(d > 0 for d in diff) == 1

# Function to return axis direction in the format {x, y, z}
def get_axis_direction(point, neighbor1, neighbor2):
    # Find which axis has differences, and return a direction vector as a formatted string
    for k in range(3):
        if point[k] != neighbor1[k] or point[k] != neighbor2[k]:
            if k == 0:  # X-axis
                return "{1, 0, 0}"
            elif k == 1:  # Y-axis
                return "{0, 1, 0}"
            elif k == 2:  # Z-axis
                return "{0, 0, 1}"
    return "{0, 0, 0}"  # Default (no direction if something went wrong)

# Lists to hold indexes of points that pass and fail the condition
passes = []
fails = []
directions = []

# Iterate over all points and check the condition
for i, point in enumerate(coords):
    neighbors = []
    # Find neighbors
    for j, other_point in enumerate(coords):
        if i != j and is_adjacent(point, other_point):
            neighbors.append(j)

    # Check if exactly two neighbors are along the same axis
    if len(neighbors) == 2:
        for k in range(3):
            # Check alignment: exactly two neighbors should differ only along one axis
            if point[k] == coords[neighbors[0]][k] == coords[neighbors[1]][k]:
                passes.append(i)
                directions.append(get_axis_direction(point, coords[neighbors[0]], coords[neighbors[1]]))
                break
        else:
            fails.append(i)
    else:
        fails.append(i)

# Output the lists of indexes that pass, fail, and the directions
print("Passes:", passes)
print("Fails:", fails)
print("Directions:", directions)
# ---------- end python_3_script_9 ----------
list_item_20 = ListItem(List=point_13, Index=python_3_script_8.one_neighbor, Wrap=True)
number_6 = Number(panel)
multiplication_7 = Multiplication(A=python_3_script_8.one_neighbor_directions, B=number_6)
point_14 = Point(point_10)
move_16 = Move(Geometry=list_item_20, Motion=multiplication_7)  # -> Geometry, Transform
line_sdl_5 = LineSDL(Start=point_14, Direction=Vector(0, 0, 1), Length="-1")
multiplication_8 = Multiplication(A=number_6, B="-2")
surface_line_3 = SurfaceLine(Surface=graft(boundary_surfaces_4), Line=flatten(line_sdl_5), LimitToFirst=False)  # -> Curves, Points, UVPoints, Normal
line_sdl_6 = LineSDL(Start=move_16.Geometry, Direction=python_3_script_8.one_neighbor_directions, Length=multiplication_8)
point_15 = Point(surface_line_3.Points)
rotate_4 = Rotate(Geometry=line_sdl_6, Angle=degrees("90"), Plane=list_item_20)  # -> Geometry, Transform
end_points_3 = EndPoints(Curve=rotate_4.Geometry)  # -> Start, End
closest_point_3 = ClosestPoint(Point=end_points_3.Start, Cloud=flatten(point_15))  # -> ClosestPoint, CPIndex, Distance
closest_point_4 = ClosestPoint(Point=end_points_3.End, Cloud=flatten(point_15))  # -> ClosestPoint, CPIndex, Distance
point_16 = Point([closest_point_3.ClosestPoint, closest_point_4.ClosestPoint])

python_3_script_10 = Python3Script(x=panel_12, y=number_3)  # -> flatten(out), fails, passes, directions; inputs x: list
# ---------- python_3_script_10: Python ----------
import ast
import math

# Input list of strings
coord_list_str = x  # Placeholder for your input list
  # Set your custom unit distance here
tolerance = 1e-6  # Small tolerance for floating-point comparisons

# Combine all strings into one and parse the coordinate strings
coords = []
for coord_str in coord_list_str:
    # Convert each string into a list of tuples
    coords += [tuple(map(float, coord.strip('{}').split(','))) for coord in ast.literal_eval(coord_str)]

# Function to check if two points differ by approximately y (within tolerance) in one coordinate
def is_adjacent(point1, point2, y):
    diff = [abs(p1 - p2) for p1, p2 in zip(point1, point2)]
    # Return True if one coordinate differs by approximately y and the others are the same
    return sum(math.isclose(d, y, abs_tol=tolerance) for d in diff) == 1 and sum(math.isclose(d, 0, abs_tol=tolerance) for d in diff) == 2

# Function to return axis direction in the format {x, y, z}
def get_axis_direction(point, neighbor1, neighbor2, y):
    for k in range(3):
        if math.isclose(abs(point[k] - neighbor1[k]), y, abs_tol=tolerance) and math.isclose(abs(point[k] - neighbor2[k]), y, abs_tol=tolerance):
            if k == 0:  # X-axis
                return "{1, 0, 0}"
            elif k == 1:  # Y-axis
                return "{0, 1, 0}"
            elif k == 2:  # Z-axis
                return "{0, 0, 1}"
    return "{0, 0, 0}"

# Lists to hold indexes of points that pass and fail the condition
passes = []
fails = []
directions = []

# Iterate over all points and check the condition
for i, point in enumerate(coords):
    neighbors = []
    # Find neighbors that differ by approximately y in one coordinate
    for j, other_point in enumerate(coords):
        if i != j and is_adjacent(point, other_point, y):
            neighbors.append(j)

    # Check if there are exactly two neighbors
    if len(neighbors) == 2:
        # Ensure both neighbors differ along the same axis and are aligned
        for k in range(3):
            if math.isclose(abs(point[k] - coords[neighbors[0]][k]), y, abs_tol=tolerance) and \
               math.isclose(abs(point[k] - coords[neighbors[1]][k]), y, abs_tol=tolerance):
                # Ensure the other two coordinates are the same
                if (math.isclose(coords[neighbors[0]][(k + 1) % 3], point[(k + 1) % 3], abs_tol=tolerance) and
                    math.isclose(coords[neighbors[0]][(k + 2) % 3], point[(k + 2) % 3], abs_tol=tolerance) and
                    math.isclose(coords[neighbors[1]][(k + 1) % 3], point[(k + 1) % 3], abs_tol=tolerance) and
                    math.isclose(coords[neighbors[1]][(k + 2) % 3], point[(k + 2) % 3], abs_tol=tolerance)):
                    passes.append(i)
                    directions.append(get_axis_direction(point, coords[neighbors[0]], coords[neighbors[1]], y))
                    break
        else:
            fails.append(i)
    else:
        fails.append(i)

# Output the lists of indexes that pass, fail, and the directions
print("Passes:", passes)
print("Fails:", fails)
print("Directions:", directions)
# ---------- end python_3_script_10 ----------
vector = Vector(python_3_script_10.directions)
panel_13 = Panel(vector)
list_item_21 = ListItem(List=point_13, Index=python_3_script_10.fails, Wrap=True)
list_item_22 = ListItem(List=point_13, Index=python_3_script_10.passes, Wrap=True)
move_to_point = MoveToPoint(Geometry=brep_2, PointA=point_5, PointB=list_item_22)  # -> Moved, Vector, Transform
plane_normal_4 = PlaneNormal(Origin=list_item_22, ZAxis=Vector(0, 0, 1))
python_3_script_11 = Python3Script(x=panel_13)  # -> out, result_list; inputs x: list
# ---------- python_3_script_11: Python ----------
def process_coordinates(coordinate_list):
    # Initialize an empty list to store the results
    result = []
    
    # Iterate through the given list of coordinates
    for coord in coordinate_list:
        # Check if the coordinate is '{1,0,0}' and append 90 to the result
        if coord == '{1,0,0}':
            result.append(90)
        # Check if the coordinate is '{0,1,0}' and append 0 to the result
        elif coord == '{0,1,0}':
            result.append(0)
        else:
            # If the coordinate is neither, raise an exception (optional)
            raise ValueError(f"Unexpected coordinate: {coord}")
    
    # Return the final result list
    return result

# Example usage
coordinates = x # Your list of coordinates
result_list = process_coordinates(coordinates)

# Output the result
print(result_list)
# ---------- end python_3_script_11 ----------

# ---- group: Landings Expanded
move_to_point_2 = MoveToPoint(Geometry=brep_3, PointA=point_5, PointB=point_16)  # -> Moved, Vector, Transform

# ---- group: Caution Pavement
move_to_point_3 = MoveToPoint(Geometry=brep_3, PointA=point_5, PointB=list_item_21)  # -> Moved, Vector, Transform

# ----
merge_2 = Merge(Data1=flatten(move_to_point_3.Moved), Data2=flatten(move_to_point_2.Moved))

# ---- group: Directional Pavement
rotate_5 = Rotate(Geometry=move_to_point.Moved, Angle=degrees(python_3_script_11.result_list), Plane=plane_normal_4)  # -> Geometry, Transform

# ----
pick_n_choose = PickNChoose(Pattern=expanded_caution_pavements, Stream0=graft(move_to_point_3.Moved), Stream1=graft(merge_2))
list_length = ListLength(List=flatten(rotate_5.Geometry))
list_length_2 = ListLength(List=flatten(pick_n_choose))
multiplication_9 = Multiplication(A=list_length, B=directional_pavement_cost)
multiplication_10 = Multiplication(A=list_length_2, B=blister_pavement_cost)
addition = Addition(A=multiplication_10, B=multiplication_9)

# ---- group: Results
num_of_directional_pavements = Panel(list_length)
num_of_blister_pavements = Panel(list_length_2)
final_cost_usd = Panel(addition)

# ---- group: Results / Renderings
custom_preview = CustomPreview(Geometry=rotate_5.Geometry, Material=ColourSwatch(SwatchColor=RGB(235, 219, 124)))
custom_preview_2 = CustomPreview(Geometry=pick_n_choose, Material=ColourSwatch(SwatchColor=RGB(200, 153, 143)))
